# Grasshopper definition unnamed.gh (Grasshopper 0.9.76)

mesh = Mesh(<mesh referenced from the Rhino model>)
faceb = FaceBoundaries(Mesh=mesh)
demesh = DeconstructMesh(Mesh=mesh)  # -> Vertices, Faces, Colours, Normals
pcen = PolygonCenter(Polyline=faceb)  # -> CenterV, CenterE, CenterA
points = PointList(Points=pcen.CenterV)
